# Grasshopper definition voronoiDome.gh (Grasshopper 1.0.7)

# ---- group: RH_IN:density
number_slider = Slider(400, range=10..400)

# ---- group: RH_IN:size
number_slider_2 = Slider(9.7, range=5..20)

# ----
multiplication = Multiplication(A=number_slider_2, B=Slider(-1, range=-1..1))
sphere = Sphere(Base=PlaneXY(0, 0, 0), Radius=number_slider_2)
center_box = CenterBox(Base=PlaneXY(0, 0, 0), X=number_slider_2, Y=number_slider_2, Z=number_slider_2)
unit_z = UnitZ(Factor=multiplication)
move = Move(Geometry=center_box, Motion=unit_z)  # -> Geometry, Transform
number_slider_3 = Slider(2, range=0..10)
solid_difference = SolidDifference(BrepsA=sphere, BrepsB=move.Geometry)
subtraction = Subtraction(A=number_slider, B=Slider(10, range=0..10))
division = Division(A=number_slider_2, B=number_slider_3)
deconstruct_brep = DeconstructBrep(Brep=solid_difference)  # -> Faces, Edges, Vertices
division_2 = Division(A=subtraction, B=Slider(390, range=0..1000))
addition = Addition(A=number_slider_2, B=Slider(1, range=0..1))
division_3 = Division(A=number_slider_2, B=number_slider_3)
addition_2 = Addition(A=division, B=Slider(0.002, range=0..1))
multiplication_2 = Multiplication(A=division_2, B=Slider(0.118, range=0..0.12))
list_item = ListItem(List=deconstruct_brep.Faces, Index=Slider(0, range=0..100), Wrap=True)
center_box_2 = CenterBox(Base=PlaneXY(0, 0, 0), X=addition, Y=addition, Z=division_3)
unit_z_2 = UnitZ(Factor=addition_2)
addition_3 = Addition(A=Slider(0.88, range=0..1), B=multiplication_2)
geometry = Geometry(list_item)
populate_geometry = PopulateGeometry(Geometry=geometry, Count=number_slider, Seed=1)
move_2 = Move(Geometry=center_box_2, Motion=unit_z_2)  # -> Geometry, Transform
scale = Scale(Geometry=geometry, Center=Point(0, 0, 0), Factor=addition_3)  # -> Geometry, Transform
voronoi_3d = Voronoi3D(Points=populate_geometry, Box=move_2.Geometry)  # -> Cells, Boundary

# ---- group: RH_OUT:mesh
mesh = Mesh(scale.Geometry)

# ----
brep_brep = BrepBrep(BrepA=voronoi_3d.Cells, BrepB=solid_difference)  # -> Curves, Points
custom_preview = CustomPreview(Geometry=mesh, Material=ColourSwatch(SwatchColor=RGB(185, 180, 240)))
curve_to_polyline = CurveToPolyline(Curve=brep_brep.Curves, ToleranceDistance=0, ToleranceAngle=0)  # -> flatten(Polyline), Segments

# ---- group: RH_OUT:edges
curve = Curve(curve_to_polyline.Polyline)
